# Grasshopper definition depthscanner_ghpython.gh (Grasshopper 1.0.7)
# plug-ins: Tarsier

scan = GhPythonScript(start=Toggle(False))  # -> out, points; inputs start: Boolean
# ---------- scan: Python ----------
import compas
import compas_rhino
import rhinoscriptsyntax as rs

from compas.rpc import Proxy

if start:

    # make the function available as a wrapped function.
    depthscanner = Proxy('depthscanner', python='C:\Users\ARCH-GIROT-W-01\Anaconda3\envs\pi27\pythonw')
    
    # test the connection to Rhino depthscanner.test()=5 
    pts = depthscanner.scan()
    
    # stop the server in so the scan-class can be updated in the background
    Proxy.stop_server(depthscanner)

    # convert the list to points and add to pointcloud
    points = []
    for i in pts:
        pnt = rs.CreatePoint(i[0],i[1],i[2])
        points.append(pnt)
        
    print('Successfully captured ' + str(len(points)) + ' points.')
# ---------- end scan ----------
construct = ConstructPointCloud(Points=scan.points)
panel = Panel(scan.out)
